# Grasshopper definition maomao_visualization.gh (Grasshopper 1.0.7)
# plug-ins: LunchBoxML, LunchBox

# ---- group: PREPROCESSING / Preprocessing: Primary Optimization
mesh = Mesh(<mesh referenced from the Rhino model>)
optimization = CSharpScript(m=mesh)  # -> out, optimized; inputs m: Mesh
# ---------- optimization: C# usings ----------
using System.IO;
using System.Linq;
using System.Data;
using System.Drawing;
using System.Reflection;
using System.Windows.Forms;
using System.Xml;
using System.Xml.Linq;
using System.Runtime.InteropServices;

using Rhino.DocObjects;
using Rhino.Collections;
using GH_IO;
using GH_IO.Serialization;
# ---------- optimization: C# ----------
    //convert all faces to triangle faces
    m.Faces.ConvertQuadsToTriangles();
    //weld mesh so that transformed mesh is a valid mesh
    m.Weld(10);
    
    optimized = m;
# ---------- end optimization ----------

# ---- group: PREPROCESSING
transnum = Slider(1132, range=0..10000)
transdis = Slider(-5, range=-10..10)

# ---- group: PREPROCESSING / Preprocessing: Manipulate Protruding Vertices
c_script = CSharpScript(m=optimization.optimized, transNum=transnum, transDis=transdis)  # -> out, transformedM; inputs m: Mesh, transNum: Int32, transDis: Double
# ---------- c_script: C# usings ----------
using Rhino.Geometry.Collections;
# ---------- c_script: C# ----------
    Mesh originalMesh = m;
    MeshVertexList originalVertices = originalMesh.Vertices;
    MeshFaceList originalFaces = originalMesh.Faces;

    // Find protruding points
    List<double> distances = new List<double>();
    Dictionary<int, double> verticesProtruding = new Dictionary<int, double>();

    for (int i = 0; i < originalMesh.Vertices.Count; i++)
    {
      Point3d vertexPoint = originalMesh.Vertices.Point3dAt(i);
      Vector3d vertexNormal = originalMesh.Normals[i];
      Plane vertexPlane = new Plane(vertexPoint, vertexNormal);
      double distance = 0;

      //
      int count = 0;
      foreach(int neighborIndex in originalMesh.Vertices.GetConnectedVertices(i))
      {
        distance += vertexPlane.DistanceTo(originalMesh.Vertices.Point3dAt(neighborIndex));
        count++;
      }
      distance = distance / count;

      //
      if (distance < 0)
      {
        verticesProtruding.Add(i, distance);
        distances.Add(distance);
      }
    }

    distances.Sort();

    List<Point3d> nose = new List<Point3d>();

    for (int j = 0; j < transNum; j++)
    {
      foreach (int i in verticesProtruding.Keys)
      {
        if (verticesProtruding[i] == distances[j])
        {
          Point3d pt = (originalMesh.Vertices.Point3dAt(i));
          Vector3d v = originalMesh.Normals[i];
          v.X = v.X * transDis * distances[j];
          v.Y = v.Y * transDis * distances[j];
          v.Z = v.Z * transDis * distances[j];
          Point3d newPt = pt + v;
          originalMesh.Vertices.SetVertex(i, newPt);
        }
      }
    }

    transformedM = originalMesh;
# ---------- end c_script ----------

# ---- group: DETECTING / GOD'S Hand
panel = Panel("1")
panel_2 = Panel("0.5")

# ---- group: DETECTING
mesh_2 = Mesh(c_script.transformedM)

# ---- group: DETECTING / Dramatise Protruding Points
c_script_2 = CSharpScript(m=mesh_2, anglemin=panel_2, anglemax=panel)  # -> out, dramaticV, dramaticB, index; inputs m: Mesh, anglemin: Double, anglemax: Double
# ---------- c_script_2: C# ----------
    m.Faces.ConvertQuadsToTriangles();
    m.Normals.ComputeNormals();

    List<Point3d> face_centers = new List<Point3d>();
    for (int i = 0; i < m.Faces.Count;i++)
    {
      face_centers.Add(m.Faces.GetFaceCenter(i));
    }

    //Create a Dict
    //Each meshface's index as keys
    //Each meshface's neighbor meshfaces as values
    Dictionary <int, int[]> neigh_faces = new Dictionary<int, int[]>();

    for(int i = 0; i < m.Faces.Count; i++)
    {
      neigh_faces[i] = m.Faces.AdjacentFaces(i);
    }


    //Create a Dict
    //Each meshface's index as keys
    //Angle between meshface normal and its neighbor meshface's normal
    Dictionary <int, List<double>> neigh_faces_rad = new Dictionary<int, List<double>>();

    for(int i = 0; i < m.Faces.Count; i++)
    {
      neigh_faces_rad[i] = new List<double>();
      foreach(int j in neigh_faces[i])
        neigh_faces_rad[i].Add(Vector3d.VectorAngle(m.FaceNormals[i], m.FaceNormals[j]));
    }

    //Create a List of Point, which are midpoints between two paired meshfaces' centers
    List<Point3d> boundary_v = new List<Point3d>();
    List<Point3d> boundary_pts = new List<Point3d>();
    HashSet<int> faceIndex = new HashSet<int>();
    HashSet<int> vIndex = new HashSet<int>();

    //List<Point3d> PTs = new List<Point3d>();

    for(int i = 0; i < m.Faces.Count; i++)
    {
      for(int j = 0; j < neigh_faces_rad[i].Count; j++)
      {
        if(neigh_faces_rad[i][j] > anglemin && neigh_faces_rad[i][j] < anglemax)
        {
          Point3d temppt1 = face_centers[i];
          Point3d temppt2 = face_centers[neigh_faces[i][j]];

          //PTs.Add(temppt1);

          Point3d temppt3 = new Point3d((temppt1.X + temppt2.X) / 2, (temppt1.Y + temppt2.Y) / 2, (temppt1.Z + temppt2.Z) / 2);
          boundary_pts.Add(temppt3);

          faceIndex.Add(i);
        }
      }
    }

    foreach (int i in faceIndex)
    {
      vIndex.Add(m.Faces[i].A);
      vIndex.Add(m.Faces[i].B);
      vIndex.Add(m.Faces[i].C);
    }

    foreach (int i in vIndex)
    {
      boundary_v.Add(m.Vertices.Point3dAt(i));
    }


    dramaticV = boundary_v;
    dramaticB = boundary_pts;
    index = vIndex;

    //test = PTs;
    //centers = face_centers;
# ---------- end c_script_2 ----------

# ---- group: SMOOTHING
number_slider = Slider(2, range=1..20)

# ---- group: CLUSTERING / Find Mesh Center
c_script_3 = CSharpScript(m=c_script.transformedM)  # -> out, mCenter, checkX, checkY, checkZ; inputs m: Mesh
# ---------- c_script_3: C# ----------
    Rhino.Geometry.Collections.MeshVertexList VLst = m.Vertices;

    double Xsum = 0;
    double Ysum = 0;
    double Zsum = 0;

    int VNum = VLst.Count;

    for (int i = 0; i < VNum; i++)
    {
      double VX = VLst[i].X;
      double VY = VLst[i].Y;
      double VZ = VLst[i].Z;
      Xsum += VX;
      Ysum += VY;
      Zsum += VZ;
    }


    Point3d center = new Point3d(Xsum / VNum, Ysum / VNum, Zsum / VNum);

    mCenter = center;
    checkX = center.X;
    checkY = center.Y;
    checkZ = center.Z;
# ---------- end c_script_3 ----------

# ---- group: CLUSTERING / Facial Characters
c_script_4 = CSharpScript(
    pt=c_script_2.dramaticB,
    checkX=c_script_3.checkX,
    checkZ=c_script_3.checkZ,
    addX=Slider(104, range=0..200),
    addZ=Slider(21, range=0..200))  # -> out, A; inputs pt: Point3d, checkX: Double, checkZ: Double, addX: Double, addZ: Double
# ---------- c_script_4: C# ----------
    if (pt.Z > (checkZ+addZ) && pt.X > (checkX+addX))
    {
      A = pt;
    }
# ---------- end c_script_4 ----------

# ---- group: SMOOTHING / Smoothing Mesh for N times
c_script_5 = CSharpScript(m=c_script.transformedM, mCenter=c_script_3.mCenter, smoothTimes=number_slider)  # -> out, A; inputs m: Mesh, mCenter: Point3d, smoothTimes: Int32
# ---------- c_script_5: C# ----------
    Mesh smoothM = m;

    for (int i = 0; i < smoothTimes; i++)
    {
      smoothM = BlurMesh(mCenter, smoothM);
    }
    
    A = smoothM;
# ---------- c_script_5: C# additional code ----------
  private Mesh BlurMesh(Point3d center, Mesh mesh)
  {
    Rhino.Geometry.Collections.MeshVertexList VLst = mesh.Vertices;
    Rhino.Geometry.Collections.MeshFaceList FLst = mesh.Faces;

    int VNum = VLst.Count;

    double centerX = center.X;
    double centerY = center.Y;
    double centerZ = center.Z;

    List<Point3d> newVLst = new List<Point3d>();

    //transformed mesh
    Rhino.Geometry.Mesh ReMesh = new Rhino.Geometry.Mesh();

    for (int i = 0; i < VNum; i++)
    {
      int [] connectedV = VLst.GetConnectedVertices(i);
      int cvNum = connectedV.Length;
      double sumX = 0;
      double sumY = 0;
      double sumZ = 0;
      foreach (int index in connectedV)
      {
        sumX += ( VLst[index].X - centerX );
        sumY += ( VLst[index].Y - centerY );
        sumZ += ( VLst[index].Z - centerZ );
      }
      double newX = centerX + (sumX / cvNum);
      double newY = centerY + (sumY / cvNum);
      double newZ = centerZ + (sumZ / cvNum);

      Point3d newV = new Point3d(newX, newY, newZ);
      newVLst.Add(newV);
    }

    for (int j = 0; j < VLst.Count; j++)
    {
      ReMesh.Vertices.Add(newVLst[j]);
    }
    for (int k = 0; k < FLst.Count; k++)
    {
      ReMesh.Faces.AddFace(FLst[k].A, FLst[k].B, FLst[k].C);
    }

    return ReMesh;
  }
# ---------- end c_script_5 ----------

# ---- group: CLUSTERING / K-Mean Cluster for Facial Characters
clean = CleanTree(RemoveNulls=True, RemoveInvalid=True, RemoveEmpty=False, Tree=c_script_4.A)
pt = Point(graft(clean))
c_script_6 = CSharpScript(pt=pt)  # -> out, A; inputs pt: Point3d
# ---------- c_script_6: C# ----------
    A = new Point3d(pt.X, 0, pt.Z);
# ---------- end c_script_6 ----------
k_means = KMeansClustering(TrainingInputs=c_script_6.A, OfClusters="4", RandomSeed=Slider(90, range=0..210))  # -> graft(Result), Likelihood, Centroids
tag = TextTag(Location=pt, Text=k_means.Result)

# ---- group: COMBINING / Read csv (updated by Pyhon Facial Detection)
panel_3 = Panel("C:\Users\dyb15\OneDrive\桌面\Introduction to Computational Design\Assignment 2\Yuebin Dong_Assignment2\Python_Submission\Facial-Expression-Recognition-master\encode.csv")
file = ReadFile(File=panel_3, PerLineParse=True)
item = CherryPicker(file, ListIndex=0)
csv = ReadCSV(CSVString=item, Delimiter=",")  # -> Headers, Values

# ---- group: DEFORMING
num = Number(flatten(k_means.Result))
pt_2 = Point(flatten(pt))

# ---- group: COMBINING / timer real time read
timer = Timer(TimerInterval=500, Target=[c_script_15, file])  # disabled

# ---- group: DEFORMING / Seperate Facial Parts
c_script_7 = CSharpScript(pts=pt_2, index=num, center=c_script_3.mCenter)  # -> out, A; inputs pts: list of Point3d, index: list of Int32, center: Point3d
# ---------- c_script_7: C# ----------
    List<Point3d> movedPts = new List<Point3d>();
    for (int i = 0; i < pts.Count; i++)
    {
      Point3d tempPt = new Point3d(pts[i]);
      if (index[i] == 3)
      {
        tempPt = new Point3d(pts[i].X, pts[i].Y, pts[i].Z + 20);
      }
      if (index[i] == 2)
      {
        tempPt = new Point3d(pts[i].X, pts[i].Y, pts[i].Z - 10);
      }
      if (index[i] == 1)
      {
        tempPt = new Point3d(pts[i].X, center.Y, pts[i].Z);
      }
      movedPts.Add(tempPt);
    }
    A = movedPts;
# ---------- end c_script_7 ----------

# ---- group: COMBINING
c_script_8 = CSharpScript()  # -> out, expression; inputs lists: list of Int32
# ---------- c_script_8: C# ----------
    Random rnd = new Random();
    expressionOne[0] = rnd.Next(0, 3);
    expressionOne[1] = rnd.Next(0, 5);
    expressionOne[2] = rnd.Next(0, 5);
    expressionOne[3] = rnd.Next(0, 5);

    expression = expressionOne;
# ---------- c_script_8: C# additional code ----------
  public int count = 0;
  public int[] expressionOne = new int[4];
# ---------- end c_script_8 ----------
timer_2 = Timer(TimerInterval=50, Target=[c_script_15, panel_5, c_script_8])  # disabled
panel_4 = Panel(c_script_8.expression)
panel_5 = Panel("1")
rec = DataRecorder(panel_5, DataLimit=-10, RecordData=True)
c_script_9 = CSharpScript(code=panel_4)  # -> out, A, B, C, D; inputs code: list of Int32
# ---------- c_script_9: C# ----------
    if (code[0] == 0)
    {
      A = "Eyebrow: Ummm Line";
    }
    else if (code[0] == 1)
    {
      A = "Eyebrow: Frown Curve";
    }
    else if (code[0] == 2)
    {
      A = "Eyebrow: Smile Curve";
    }


    if (code[1] == 0)
    {
      B = "Eye1: Ummm Line";
    }
    else if (code[1] == 1)
    {
      B = "Eye1: Frown Curve";
    }
    else if (code[1] == 2)
    {
      B = "Eye1: Smile Curve";
    }
    else if (code[1] == 3)
    {
      B = "Eye1: Kiss Circle";
    }
    else if (code[1] == 4)
    {
      B = "Eye1: Awe Circle";
    }

    if (code[2] == 0)
    {
      C = "Eye2: Ummm Line";
    }
    else if (code[2] == 1)
    {
      C = "Eye2: Frown Curve";
    }
    else if (code[2] == 2)
    {
      C = "Eye2: Smile Curve";
    }
    else if (code[2] == 3)
    {
      C = "Eye2: Kiss Circle";
    }
    else if (code[2] == 4)
    {
      C = "Eye2: Awe Circle";
    }

    if (code[3] == 0)
    {
      D = "Mouth: Ummm Line";
    }
    else if (code[3] == 1)
    {
      D = "Mouth: Frown Curve";
    }
    else if (code[3] == 2)
    {
      D = "Mouth: Smile Curve";
    }
    else if (code[3] == 3)
    {
      D = "Mouth: Kiss Circle";
    }
    else if (code[3] == 4)
    {
      D = "Mouth: Awe Circle";
    }
# ---------- end c_script_9 ----------
ma = MassAddition(Input=rec)  # -> Result, PartialResults
pt_3 = Point(<point referenced from the Rhino model>)
merge = Merge(Data1=c_script_9.A, Data2=c_script_9.B, Data3=c_script_9.C, Data4=c_script_9.D)
pt_4 = Point([<point referenced from the Rhino model> x4])
join = TextJoin(Text=["expression No. ", ma.Result])
swatch = ColourSwatch(SwatchColor=RGB(0, 0, 0))
tag_2 = TextTag(Location=pt_3, Text=join, Colour=swatch)
tag_3 = TextTag(Location=pt_4, Text=merge, Colour=swatch)

# ---- group: DEFORMING / Get Featuring Vertices Indices
c_script_10 = CSharpScript(targetM=c_script_5.A, mCenter=c_script_3.mCenter, keyPts=c_script_7.A, labels=num)  # -> out, A, eye0_1, eye0_2, mouth2, eyebrow3_1, eyebrow3_2; inputs targetM: Mesh, mCenter: Point3d, keyPts: list of Point3d, labels: list of Int32
# ---------- c_script_10: C# ----------
    Rhino.Geometry.Collections.MeshVertexList VLst = targetM.Vertices;

    //ruler for character labels
    List<Ruler> rulers = new List<Ruler>();
    for (int i = 0; i < labels.Count; i++)
    {
      Ruler tempR = new Ruler(keyPts[i], (labels[i]));
      rulers.Add(tempR);
    }

    //list for color value
    List<double> labelValues = new List<double>();

    //lists for facial character indexes
    List<int> Eye0_1 = new List<int>();
    List<int> Eye0_2 = new List<int>();
    List<int> Nose1 = new List<int>();
    List<int> Mouth2 = new List<int>();
    List<int> Eyebrow3_1 = new List<int>();
    List<int> Eyebrow3_2 = new List<int>();


    //find closest ruler and put indexes into respective lists
    for (int i = 0; i < VLst.Count; i++)
    {

      Point3d testPt = new Point3d(VLst[i]);
      int tempIndex = FindClosestIndex(keyPts, testPt);
      int rawLabel = rulers[tempIndex].Label;

      double finalLabel = 0;
      double testDis = (new Line(testPt, keyPts[tempIndex])).Length;

      //fill in character index lists
      double faceCenter = mCenter.Y;
      if (testDis < 10)
      {
        //find Eye_1 vertices
        if (rawLabel == 0 && testPt.Y < (faceCenter - 18))
        {
          Eye0_1.Add(i);
        }
        //find Eye_2 vertices
        if (rawLabel == 0 && testPt.Y > (faceCenter + 18))
        {
          Eye0_2.Add(i);
        }
        //find Nose vertices
        if (rawLabel == 1)
        {
          Nose1.Add(i);
        }
        //find Mouth vertices
        if (rawLabel == 2)
        {
          Mouth2.Add(i);
        }
      }
      if (testDis < 20)
      {
        //find Eyebrow_1 vertices
        if (rawLabel == 3 && testPt.Y < faceCenter)
        {
          Eyebrow3_1.Add(i);
        }
        //find Eyebrow_2 vertices
        if (rawLabel == 3 && testPt.Y > faceCenter)
        {
          Eyebrow3_2.Add(i);
        }
      }


      //fill in color lists
      if (testDis > 20)
      {
        finalLabel = 5;
      }
      else
      {
        finalLabel = rawLabel + (1 - 2 / testDis);
      }
      labelValues.Add(finalLabel);

    }


    eye0_1 = Eye0_1;
    eye0_2 = Eye0_2;
    //nose1 = Nose1;
    mouth2 = Mouth2;
    eyebrow3_1 = Eyebrow3_1;
    eyebrow3_2 = Eyebrow3_2;

    Mesh colored = ColorMesh(targetM, labelValues);
    //colored.FillHoles();

    A = colored;
# ---------- c_script_10: C# additional code ----------
  //https://www.grasshopper3d.com/forum/topics/gradient-grasshopper-c
  //modified
  private Mesh ColorMesh(Mesh mesh, List<double> ValueList)
  {
    System.Drawing.Color C0 = System.Drawing.Color.FromArgb(10, 255, 10, 20);
    System.Drawing.Color C1 = System.Drawing.Color.FromArgb(20, 100, 100, 100);
    System.Drawing.Color C2 = System.Drawing.Color.FromArgb(30, 200, 80, 90);
    System.Drawing.Color C3 = System.Drawing.Color.FromArgb(50, 255, 255, 255);
    System.Drawing.Color C4 = System.Drawing.Color.FromArgb(70, 225, 180, 0);
    System.Drawing.Color C5 = System.Drawing.Color.FromArgb(80, 205, 105, 200);

    List<System.Drawing.Color> colorList = new List<System.Drawing.Color>();

    double min0 = 0.0;
    double max5 = 5.0;
    double g1 = 1.0;
    double g2 = 2.0;
    double g3 = 3.0;
    double g4 = 4.0;

    Grasshopper.GUI.Gradient.GH_Gradient gradient = new Grasshopper.GUI.Gradient.GH_Gradient();
    gradient.AddGrip(min0, C0);
    gradient.AddGrip(max5, C5);
    gradient.AddGrip(g1, C1);
    gradient.AddGrip(g2, C2);
    gradient.AddGrip(g3, C3);
    gradient.AddGrip(g4, C4);

    foreach (var Value in ValueList)
    {
      System.Drawing.Color c = gradient.ColourAt(Value);
      colorList.Add(c);
    }


    //list to array
    System.Drawing.Color[] arCol = colorList.ToArray();
    mesh.VertexColors.SetColors(arCol);
    return mesh;
  }

  //find closest index
  private int FindClosestIndex (List < Point3d > C, Point3d P)
  {
    int count = C.Count;
    double dis = 1000000;
    int label = 0;
    Point3d point = new Point3d(0, 0, 0);

    for (int k = 0; k < count; k++){
      double tem_d = (new Line(P, C[k])).Length;
      if (tem_d <= dis){
        dis = tem_d;
        label = k;
        point = C[k];
      }
    }
    return label;
  }

  //Ruler class used for facial characters
  public class Ruler
  {
    public Point3d Location;
    public int Label;

    public Ruler(Point3d locPt, int index)
    {
      this.Location = locPt;
      this.Label = index;
    }
  }
# ---------- end c_script_10 ----------

# ---- group: DEFORMING / one vertix only exist in one bucket
c_script_11 = CSharpScript(x=c_script_10.eye0_1, y=c_script_10.eye0_2, u=c_script_10.mouth2, v=c_script_10.eyebrow3_1, w=c_script_10.eyebrow3_2)  # -> out, A, B, C, D, E, F; inputs x: list of Int32, y: list of Int32, u: list of Int32, v: list of Int32, w: list of Int32
# ---------- c_script_11: C# ----------
    List<int> checkList = new List<int>();

    List<int> a = new List<int>();
    List<int> b = new List<int>();
    List<int> c = new List<int>();
    List<int> d = new List<int>();
    List<int> e = new List<int>();
    List<int> f = new List<int>();

    for (int i = 0; i < x.Count; i++)
    {
      checkList.Add(x[i]);
      a.Add(x[i]);
    }
    for (int i = 0; i < y.Count; i++)
    {
      if (checkList.Contains(y[i]))
      {}
      else
      {
        checkList.Add(y[i]);
        b.Add(y[i]);
      }
    }
    for (int i = 0; i < u.Count; i++)
    {
      if (checkList.Contains(u[i]))
      {}
      else
      {
        checkList.Add(u[i]);
        d.Add(u[i]);
      }
    }
    for (int i = 0; i < v.Count; i++)
    {
      if (checkList.Contains(v[i]))
      {}
      else
      {
        checkList.Add(v[i]);
        e.Add(v[i]);
      }
    }
    for (int i = 0; i < w.Count; i++)
    {
      if (checkList.Contains(w[i]))
      {}
      else
      {
        checkList.Add(w[i]);
        f.Add(w[i]);
      }
    }
    /*for (int i = 0; i < z.Count; i++)
    {
      if (checkList.Contains(z[i]))
      {}
      else
      {
        checkList.Add(z[i]);
        c.Add(z[i]);
      }
    }*/

    A = a;
    B = b;
    //C = c;
    D = d;
    E = e;
    F = f;
# ---------- end c_script_11 ----------

# ---- group: DEFORMING / On-Mesh Manipulate Featuring Vertices
c_script_12 = CSharpScript(
    m=c_script_10.A,
    eye0_1=c_script_11.A,
    eye0_2=c_script_11.B,
    mouth2=c_script_11.D,
    eyebrow3_1=c_script_11.E,
    eyebrow3_2=c_script_11.F,
    expCode=c_script_8.expression)  # -> out, meshout; inputs m: Mesh, eye0_1: list of Int32, eye0_2: list of Int32, mouth2: list of Int32, eyebrow3_1: list of Int32, eyebrow3_2: list of Int32, expCode: list of Int32
# ---------- c_script_12: C# ----------
    // get eye center
    List<Point3d> AllEye = new List<Point3d>();
    for (int i = 0; i < eye0_1.Count; i++)
    {
      Point3d pt = new Point3d(m.Vertices[eye0_1[i]]);
      AllEye.Add(pt);
    }
    for (int i = 0; i < eye0_2.Count; i++)
    {
      Point3d pt = new Point3d(m.Vertices[eye0_2[i]]);
      AllEye.Add(pt);
    }
    Point3d EyeC = GetCenter(AllEye);
    // get origin for both eyes
    List<Point3d> E1 = new List<Point3d>();
    List<Point3d> E2 = new List<Point3d>();
    for (int i = 0; i < eye0_1.Count; i++)
    {
      Point3d pt = new Point3d(m.Vertices[eye0_1[i]]);
      E1.Add(pt);
    }
    for (int i = 0; i < eye0_2.Count; i++)
    {
      Point3d pt = new Point3d(m.Vertices[eye0_2[i]]);
      E2.Add(pt);
    }
    Point3d EyeC1 = new Point3d(EyeC.X, GetCenter(E1).Y, EyeC.Z);
    Point3d EyeC2 = new Point3d(EyeC.X, GetCenter(E2).Y, EyeC.Z);

    // get eyebrow center
    List<Point3d> AllEB = new List<Point3d>();
    for (int i = 0; i < eyebrow3_1.Count; i++)
    {
      Point3d pt = new Point3d(m.Vertices[eyebrow3_1[i]]);
      AllEB.Add(pt);
    }
    for (int i = 0; i < eyebrow3_2.Count; i++)
    {
      Point3d pt = new Point3d(m.Vertices[eyebrow3_2[i]]);
      AllEB.Add(pt);
    }
    Point3d EBC = GetCenter(AllEB);
    // get origin for both eyebrows
    List<Point3d> EB1 = new List<Point3d>();
    List<Point3d> EB2 = new List<Point3d>();
    for (int i = 0; i < eyebrow3_1.Count; i++)
    {
      Point3d pt = new Point3d(m.Vertices[eyebrow3_1[i]]);
      EB1.Add(pt);
    }
    for (int i = 0; i < eyebrow3_2.Count; i++)
    {
      Point3d pt = new Point3d(m.Vertices[eyebrow3_2[i]]);
      EB2.Add(pt);
    }
    Point3d EBC1 = new Point3d(EBC.X, GetCenter(EB1).Y, EBC.Z + 10);
    Point3d EBC2 = new Point3d(EBC.X, GetCenter(EB2).Y, EBC.Z + 10);

    // get nose origin
    /*List<Point3d> N = new List<Point3d>();
    for (int i = 0; i < nose1.Count; i++)
    {
      Point3d pt = new Point3d(m.Vertices[nose1[i]]);
      N.Add(pt);
    }
    Point3d NC = GetCenter(N);*/

    // get mouth origin
    List<Point3d> M = new List<Point3d>();
    for (int i = 0; i < mouth2.Count; i++)
    {
      Point3d pt = new Point3d(m.Vertices[mouth2[i]]);
      M.Add(pt);
    }
    Point3d MC = GetCenter(M);



    //Eye1 Shape
    NurbsCurve EL1 = new NurbsCurve(3, 3);
    if (expCode[1] == 0)
    {
      EL1 = GetLine(EyeC1, 40);
    }
    else if (expCode[1] == 1)
    {
      EL1 = GetFrown(EyeC1, 60, 20);
    }
    else if (expCode[1] == 2)
    {
      EL1 = GetSmile(EyeC1, 60, 20);
    }
    else if (expCode[1] == 3)
    {
      EL1 = GetCircle(EyeC1, 8);
    }
    else if (expCode[1] == 4)
    {
      EL1 = GetCircle(EyeC1, 20);
    }

    //Eye2 Shape
    NurbsCurve EL2 = new NurbsCurve(3, 3);
    if (expCode[2] == 0)
    {
      EL2 = GetLine(EyeC2, 40);
    }
    else if (expCode[2] == 1)
    {
      EL2 = GetFrown(EyeC2, 60, 20);
    }
    else if (expCode[2] == 2)
    {
      EL2 = GetSmile(EyeC2, 60, 20);
    }
    else if (expCode[2] == 3)
    {
      EL2 = GetCircle(EyeC2, 8);
    }
    else if (expCode[2] == 4)
    {
      EL2 = GetCircle(EyeC2, 20);
    }

    //Eyebrow1 and Eyebrow2 Shape
    NurbsCurve EBL1 = new NurbsCurve(3, 3);
    NurbsCurve EBL2 = new NurbsCurve(3, 3);
    if (expCode[0] == 0)
    {
      EBL1 = GetLine(EBC1, 30);
      EBL2 = GetLine(EBC2, 30);
    }
    else if (expCode[0] == 1)
    {
      EBL1 = GetFrown(EBC1, 60, 30);
      EBL2 = GetFrown(EBC2, 60, 30);
    }
    else if (expCode[0] == 2)
    {
      EBL1 = GetSmile(EBC1, 60, 30);
      EBL2 = GetSmile(EBC2, 60, 30);
    }

    //Nose Shape
    /*NurbsCurve NL;
    if (true)
    {
      NL = GetCircle(NC, 12);
    }*/

    //Mouth Shape
    NurbsCurve ML = new NurbsCurve(3, 3);
    if (expCode[3] == 0)
    {
      ML = GetLine(MC, 60);
    }
    else if (expCode[3] == 1)
    {
      ML = GetFrown(MC, 80, 30);
    }
    else if (expCode[3] == 2)
    {
      ML = GetSmile(MC, 80, 30);
    }
    else if (expCode[3] == 3)
    {
      ML = GetCircle(MC, 5);
    }
    else if (expCode[3] == 4)
    {
      ML = GetCircle(MC, 25);
    }


    //change expression
    Rhino.Geometry.Collections.MeshVertexList VLst = m.Vertices;
    Rhino.Geometry.Collections.MeshFaceList FLst = m.Faces;

    List<Point3d> movedPts = new List<Point3d>();
    for (int i = 0; i < VLst.Count; i++)
    {
      Point3d TestPt = new Point3d(VLst[i]);

      if (eye0_1.Contains(i))
      {
        movedPts.Add(MovetoCrv(TestPt, EL1));
      }
      else if (eye0_2.Contains(i))
      {
        movedPts.Add(MovetoCrv(TestPt, EL2));
      }
      else if (eyebrow3_1.Contains(i))
      {
        movedPts.Add(MovetoCrv(TestPt, EBL1));
      }
      else if (eyebrow3_2.Contains(i))
      {
        movedPts.Add(MovetoCrv(TestPt, EBL2));
      }
      //else if (nose1.Contains(i))
      //{
        //movedPts.Add(MovetoCrv(TestPt, NL));
      //}
      else if (mouth2.Contains(i))
      {
        movedPts.Add(MovetoCrv(TestPt, ML));
      }
      else
      {
        movedPts.Add(TestPt);
      }
    }


    //transformed mesh

    //vertex normals of original mesh
    m.Normals.ComputeNormals();
    Rhino.Geometry.Collections.MeshVertexNormalList NLst = m.Normals;


    Rhino.Geometry.Mesh ReMesh = new Rhino.Geometry.Mesh();
    for (int i = 0; i < VLst.Count; i++)
    {
      ReMesh.Vertices.Add(movedPts[i]);
    }
    for (int i = 0; i < FLst.Count; i++)
    {
      ReMesh.Faces.AddFace(FLst[i].A, FLst[i].B, FLst[i].C);
    }


    meshout = ReMesh;
# ---------- c_script_12: C# additional code ----------
  // get center point of point cloud
  private Point3d GetCenter(List<Point3d> Cloud)
  {
    double Xsum = 0;
    double Ysum = 0;
    double Zsum = 0;
    int Cnum = Cloud.Count;

    for (int i = 0; i < Cnum; i++)
    {
      Xsum += Cloud[i].X;
      Ysum += Cloud[i].Y;
      Zsum += Cloud[i].Z;
    }

    Point3d center = new Point3d(Xsum / Cnum, Ysum / Cnum, Zsum / Cnum);
    return center;
  }

  //move point to closest location on curve
  private Point3d MovetoCrv (Point3d ori, NurbsCurve targetCrv)
  {
    double t = 0;
    targetCrv.ClosestPoint(ori, out t);
    return targetCrv.PointAt(t);
  }

  //generate line
  private NurbsCurve GetLine(Point3d ori, double len)
  {
    Point3d start = new Point3d(ori.X, ori.Y - len / 2, ori.Z);
    Point3d end = new Point3d(ori.X, ori.Y + len / 2, ori.Z);
    Line l = new Line(start, end);
    NurbsCurve c = l.ToNurbsCurve();
    return c;
  }

  //generate circle
  private NurbsCurve GetCircle(Point3d ori, double r)
  {
    Plane p = new Plane(ori, new Vector3d(1, 0, 0));
    Circle cir = new Circle(p, r);
    NurbsCurve c = cir.ToNurbsCurve();
    return c;
  }

  //generate "smile curve"
  private NurbsCurve GetSmile(Point3d ori, double len, double h)
  {
    Point3d start = new Point3d(ori.X, ori.Y - len / 2, ori.Z + h);
    Point3d mid = new Point3d(ori.X, ori.Y, ori.Z - 1.5 * h);
    Point3d end = new Point3d(ori.X, ori.Y + len / 2, ori.Z + h);
    List<Point3d> pts = new List<Point3d>();
    pts.Add(start);
    pts.Add(mid);
    pts.Add(end);
    BezierCurve bc = new BezierCurve(pts);
    NurbsCurve c = bc.ToNurbsCurve();
    return c;
  }

  //generate "frown curve"
  private NurbsCurve GetFrown(Point3d ori, double len, double h)
  {
    Point3d start = new Point3d(ori.X, ori.Y - len / 2, ori.Z - h);
    Point3d mid = new Point3d(ori.X, ori.Y, ori.Z + 1.5 * h);
    Point3d end = new Point3d(ori.X, ori.Y + len / 2, ori.Z - h);
    List<Point3d> pts = new List<Point3d>();
    pts.Add(start);
    pts.Add(mid);
    pts.Add(end);
    BezierCurve bc = new BezierCurve(pts);
    NurbsCurve c = bc.ToNurbsCurve();
    return c;
  }
# ---------- end c_script_12 ----------

# ---- group: SUBDIVIDING
number_slider_2 = Slider(2, range=0..10)

# ---- group: SUBDIVIDING / Subdivide and Densify Featuring Parts
c_script_13 = CSharpScript(
    m=c_script_12.meshout,
    eye0_1=c_script_11.A,
    eye0_2=c_script_11.B,
    nose1=c_script_11.C,
    mouth2=c_script_11.D,
    eyebrow3_1=c_script_11.E,
    eyebrow3_2=c_script_11.F,
    degree=number_slider_2)  # -> out, A, B; inputs m: Mesh, eye0_1: list of Int32, eye0_2: list of Int32, nose1: list of Int32, mouth2: list of Int32, eyebrow3_1: list of Int32, eyebrow3_2: list of Int32, degree: Int32
# ---------- c_script_13: C# ----------
    List<Mesh> newMesh = new List<Mesh>();
    newMesh.AddRange(subdivide(m, eye0_1, degree, 0));
    newMesh.AddRange(subdivide(m, eye0_2, degree, 0));
    newMesh.AddRange(subdivide(m, nose1, degree, 0));
    newMesh.AddRange(subdivide(m, mouth2, degree, 0));
    newMesh.AddRange(subdivide(m, eyebrow3_1, degree, 0));
    newMesh.AddRange(subdivide(m, eyebrow3_2, degree, 0));

    A = m;
    B = newMesh;
# ---------- c_script_13: C# additional code ----------
  // subdivide part of faces in a mesh specified by input, by degree times.
  // The function modifies orinally input mesh.
  //
  // param:
  //   m - Mesh to modify
  //   indecies - List of int, indexs of vertices where to modify
  //   degree - int, how many times the mesh will be subdivided
  //
  // return:
  //   bool - true if there is no recursive call left
  //
  public List<Mesh> subdivide(Mesh m, List<int> vertices, int degree, int times)
  {
    // Get a list of indecies of faces which connected to vertices to modify
    List<int> indices = getConnectedFaces(m, vertices);
    // Create a list to store the indices of new surfaces
    List<int> newIndices = new List<int>();
    // Create a list to store the indices of new surfaces
    List<int> newVertexList = new List<int>();
    Mesh newMesh = new Mesh();


    // Enumerate every index of faces to modify
    for (int i = 0; i < indices.Count; i++)
    {
      // Find indecies of three corners of this face
      List<int> oldVertices = new List<int>();
      // a
      oldVertices.Add(m.Faces[indices[i]].A);
      // b
      oldVertices.Add(m.Faces[indices[i]].B);
      // c
      oldVertices.Add(m.Faces[indices[i]].C);
      // Record the orginal vertices on the corners of new faces
      List<int> originalCorners = new List<int>();

      // Record the indices of new vertices
      List<int> newVertices = new List<int>();
      for (int j = 0; j < 3; j++)
      {
        if (vertices.Contains(oldVertices[j]))
        {
          originalCorners.Add(oldVertices[j]);
        }
      }

      Point3d aPt = m.Vertices.Point3dAt(oldVertices[0]);
      Point3d bPt = m.Vertices.Point3dAt(oldVertices[1]);
      Point3d cPt = m.Vertices.Point3dAt(oldVertices[2]);

      // Add midpoints to the VerticesList of the Mesh
      // Midpoint of ab
      newVertices.Add((m.Vertices.Add((bPt.X + aPt.X) / 2, (bPt.Y + aPt.Y) / 2, (bPt.Z + aPt.Z) / 2)));
      // Midpoint of bc
      newVertices.Add((m.Vertices.Add((cPt.X + bPt.X) / 2, (cPt.Y + bPt.Y) / 2, (cPt.Z + bPt.Z) / 2)));
      // Midpoint of ca
      newVertices.Add((m.Vertices.Add((aPt.X + cPt.X) / 2, (aPt.Y + cPt.Y) / 2, (aPt.Z + cPt.Z) / 2)));

      // Add new faces
      // Record the indices of new faces
      int useless = 0;
      for (int j = 0; j < 3; j++)
      {
        if (vertices.Contains(oldVertices[j]))
        {
          newIndices.Add(m.Faces.AddFace(oldVertices[j], newVertices[j], newVertices[(j - 1 + 3) % 3]));
          if (times > -1)
          {
            newMesh.Vertices.Add(m.Vertices.Point3dAt(oldVertices[j]));
            newMesh.Vertices.Add(m.Vertices.Point3dAt(newVertices[j]));
            newMesh.Vertices.Add(m.Vertices.Point3dAt(newVertices[(j - 1 + 3) % 3]));
            newMesh.Faces.AddFace(newMesh.Vertices.Count - 1, newMesh.Vertices.Count - 2, newMesh.Vertices.Count - 3);
          }
          useless = newVertices[(j + 1) % 3];
        }
      }
      if (originalCorners.Count > 1)
      {
        if (times > -1)
        {
          newIndices.Add(m.Faces.AddFace(newVertices[0], newVertices[1], newVertices[2]));
          newMesh.Vertices.Add(m.Vertices.Point3dAt(newVertices[0]));
          newMesh.Vertices.Add(m.Vertices.Point3dAt(newVertices[1]));
          newMesh.Vertices.Add(m.Vertices.Point3dAt(newVertices[2]));
          newMesh.Faces.AddFace(newMesh.Vertices.Count - 1, newMesh.Vertices.Count - 2, newMesh.Vertices.Count - 3);
        }

        foreach(int vertex in newVertices)
        {
          Vector3d a = new Vector3d(
            m.Vertices.Point3dAt(originalCorners[0]).X - m.Vertices.Point3dAt(vertex).X,
            m.Vertices.Point3dAt(originalCorners[0]).Y - m.Vertices.Point3dAt(vertex).Y,
            m.Vertices.Point3dAt(originalCorners[0]).Z - m.Vertices.Point3dAt(vertex).Z
            );
          Vector3d b = new Vector3d(
            m.Vertices.Point3dAt(vertex).X - m.Vertices.Point3dAt(originalCorners[1]).X,
            m.Vertices.Point3dAt(vertex).Y - m.Vertices.Point3dAt(originalCorners[1]).Y,
            m.Vertices.Point3dAt(vertex).Z - m.Vertices.Point3dAt(originalCorners[1]).Z
            );
          if (a == b)
          {
            vertices.Add(vertex);
          }
        }
      }
      // Delete useless new vertices
      if (originalCorners.Count < 2)
      {
        m.Vertices.Remove(useless, true);
      }
    }


    List<Mesh> newMeshList = new List<Mesh>();

    // Use the degree to store times of recursive calls decrementally.
    // Check if there is no recursive call left.
    if (degree == 0)
    {
      return newMeshList;
    }

    newMeshList = subdivide(m, vertices, degree - 1, times + 1);
    newMeshList.Add(newMesh);

    return newMeshList;
  }

  // Get a list of indecies of Faces
  // that share the vertices difined by the input List of indecies
  public List<int> getConnectedFaces(Mesh m, List<int> vertices)
  {
    List<int> connectedFaces = new List<int>();

    for (int i = 0; i < vertices.Count; i++)
    {
      int[] faces = m.Vertices.GetVertexFaces(vertices[i]);
      foreach (int face in faces)
      {
        if (!connectedFaces.Contains(face))
        {
          connectedFaces.Add(face);
        }
      }
    }

    return connectedFaces;
  }
# ---------- end c_script_13 ----------

# ---- group: VISUALIZING
X = UnitX(Factor=Slider(10, range=0..10))
move = Move(Geometry=c_script_13.B, Motion=X)  # -> Geometry, Transform
material = CreateMaterial(
    Diffuse=RGB(255, 105, 180),
    Specular=RGB(255, 255, 255),
    Emission=RGB(0, 0, 0),
    Transparency=Slider(0.971, range=0..1),
    Shine=0)
preview = CustomPreview(Geometry=move.Geometry, Material=material)

# ---- group: VISUALIZING / Color Featuring Facial Parts
c_script_14 = CSharpScript(
    m=c_script_12.meshout,
    eye0_1=c_script_11.A,
    eye0_2=c_script_11.B,
    mouth2=c_script_11.D,
    eyebrow3_1=c_script_11.E,
    eyebrow3_2=c_script_11.F)  # -> out, A; inputs m: Mesh, eye0_1: list of Int32, eye0_2: list of Int32, mouth2: list of Int32, eyebrow3_1: list of Int32, eyebrow3_2: list of Int32
# ---------- c_script_14: C# ----------
    Rhino.Geometry.Collections.MeshVertexList VLst = m.Vertices;
    List<double> Color = new List<double>();
    List < System.Drawing.Color> colors = new List<System.Drawing.Color>();

    System.Drawing.Color all_color = System.Drawing.Color.FromArgb(200, 200, 200);

    for (int i = 0; i < VLst.Count; i++)
    {
      if (eye0_1.Contains(i))
      {
        Color.Add(1);
        colors.Add(all_color);
      }
      else if (eye0_2.Contains(i))
      {
        Color.Add(1);
        colors.Add(all_color);
      }
      else if (eyebrow3_1.Contains(i))
      {
        Color.Add(4);
        colors.Add(all_color);
      }
      else if (eyebrow3_2.Contains(i))
      {
        Color.Add(4);
        colors.Add(all_color);
      }
      //else if (nose1.Contains(i))
      //{
      //  Color.Add(2);
      // colors.Add(all_color);
      //}
      else if (mouth2.Contains(i))
      {
        Color.Add(3);
        colors.Add(all_color);
      }
      else
      {
        Color.Add(0);
        colors.Add(System.Drawing.Color.White);
      }
    }

    System.Drawing.Color[] Col = colors.ToArray();
    m.VertexColors.SetColors(Col);
    m.FillHoles();
    A = m;
# ---------- end c_script_14 ----------

# ---- group: VISUALIZING
number_slider_3 = Slider(0.4, range=0..1)
number_slider_4 = Slider(1.2, range=0..2)
medges = MeshEdges(Mesh=c_script_13.A)  # -> NakedEdges, InteriorEdges, NonManifoldEdges
mesh_3 = Mesh(c_script_14.A)

# ---- group: VISUALIZING / create sketchy effects
c_script_15 = CSharpScript(m=c_script_13.A, removeRatio=number_slider_3, sketchyRatio=number_slider_4)  # -> out, A; inputs m: Mesh, removeRatio: Double, sketchyRatio: Double
# ---------- c_script_15: C# ----------
    Rhino.Geometry.Collections.MeshTopologyEdgeList ELst = m.TopologyEdges;
    List<Line> ELs = new List<Line>();

    // all mesh edges in list
    for (int i = 0; i < ELst.Count; i++)
    {
      ELs.Add(ELst.EdgeLine(i));
    }

    // random reduce certain ratio of edges to create a continuous sketchy effect
    int oNum = ELst.Count;
    int rNum = Convert.ToInt32(Math.Floor(oNum * removeRatio));

    List<int> reduceIndex = new List<int>();

    // generate list of indexes to reduce the lines
    while (reduceIndex.Count < (rNum))
    {
      int tempIndex = GetRandomNumber(0, oNum - 1);
      if (reduceIndex.Contains(tempIndex))
      {
      }
      else
      {
        reduceIndex.Add(tempIndex);
      }
    }
    reduceIndex.Sort();
    reduceIndex.Reverse();

    //remove edges according to indexes
    foreach (int index in reduceIndex)
    {
      ELs.RemoveAt(index);
    }

    // extend remaining edges
    List<Line> extendLs = new List<Line>();
    for (int i = 0; i < ELs.Count; i++)
    {
      double tempL = ELs[i].Length;
      double extendL = tempL * sketchyRatio;
      Line tempExtended = ExtendLine(ELs[i],extendL);
      extendLs.Add(tempExtended);
    }

    A = extendLs;
# ---------- c_script_15: C# additional code ----------
  // https://www.jb51.net/article/35909.htm
  public static int GetRandomNumber(int min, int max)
  {
    int rtn = 0;
    Random r = new Random();
    byte[] buffer = Guid.NewGuid().ToByteArray();
    int iSeed = BitConverter.ToInt32(buffer, 0);
    r = new Random(iSeed);
    rtn = r.Next(min, max + 1);
    return rtn;
  }

  // extend line on both sides
  private Line ExtendLine (Line l, double len)
  {
    Point3d start = l.From;
    Point3d end = l.To;
    Point3d p1 = new Point3d((start.X - end.X), (start.Y - end.Y), (start.Z - end.Z));
    Point3d p2 = new Point3d((end.X - start.X), (end.Y - start.Y), (end.Z - start.Z));
    Vector3d e1 = new Vector3d(p1);
    Vector3d e2 = new Vector3d(p2);
    
    double tempL = l.Length;
    double ratio = len / tempL;
    
    Transform T1 = Transform.Translation(Vector3d.Multiply((e1), ratio));
    Transform T2 = Transform.Translation(Vector3d.Multiply((e2), ratio));
    start.Transform(T1);
    end.Transform(T2);
    
    Line extendL = new Line(start, end);
    return extendL;
  }
# ---------- end c_script_15 ----------

# ---- group: VISUALIZING (continued)
merge_2 = Merge(Data1=medges.InteriorEdges, Data2=c_script_15.A)
preview_2 = CustomPreview(Geometry=merge_2, Material=ColourSwatch(SwatchColor=RGB(0, 0, 0)))
